% Simulink data dictionary rostest_testsendrcv.sldd

c1 = Simulink.Parameter(5, StorageClass="ExportedGlobal", DataType="single")
x_input = Simulink.Parameter([1 2 3 4 5], StorageClass="ExportedGlobal", DataType="single")
x_output = Simulink.Parameter([2 4 6 8 10], StorageClass="ExportedGlobal", DataType="single")
result = Simulink.Signal(StorageClass="ExportedGlobal", DataType="single", InitialValue="0")

CalibDataEnumType = enum(DefaultValue="ROSCAL_DT_UINT8", StorageType="uint8")
  ROSCAL_DT_UINT8 = 1
  ROSCAL_DT_UINT16 = 2
  ROSCAL_DT_UINT32 = 3
  ROSCAL_DT_INT16 = 4
  ROSCAL_DT_INT32 = 5
  ROSCAL_DT_INT64 = 6
  ROSCAL_DT_FLOAT = 7
  ROSCAL_DT_DOUBLE = 8

result2 = Simulink.Signal(StorageClass="ExportedGlobal", DataType="single", InitialValue="0")

map2d = Simulink.Parameter([7 33 68 16 58 29 76 56 62 44 12 16 53 96 23 85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
 44 41 44 40 82 83 100 76 38 5 41 46 33 90 94 36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
 18 55 70 38 41 20 19 100 88 5 89 62 84 36 69 44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
 3 5 26 14 99 45 79 97 79 10 55 94 82 55 97 58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
 96 56 1 44 9 40 20 54 47 60 37 84 56 35 44 71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
 44 28 54 10 33 83 100 97 82 25 21 90 27 63 95 75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
 97 25 28 62 52 68 81 12 90 85 45 59 69 80 1 76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
 77 25 95 2 7 21 43 6 43 86 96 59 24 75 62 39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
 1 16 91 58 73 32 73 31 34 97 13 86 46 13 81 43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
 69 96 40 79 56 14 50 59 60 49 48 4 39 83 24 96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 ], StorageClass="ExportedGlobal", DataType="single")

map2d_x = Simulink.Parameter([2 4 6 8 10 12 14 16 18 20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 84], StorageClass="ExportedGlobal", DataType="single")
map2d_y = Simulink.Parameter([1 2 3 4 5 6 7 8 9 10 11 12 13 14 15 16 17 18 19 20 21 22 23 24 25 26 27 28 29 30 31 32 33 34 35], StorageClass="ExportedGlobal", DataType="single")
x_lu_output3 = Simulink.Signal(StorageClass="ExportedGlobal", DataType="single")

point_t = Simulink.Bus(DataScope="Imported", HeaderFile="struct_import.h")
  x: single
  y: single

pose_t = Simulink.Bus(DataScope="Imported", HeaderFile="struct_import.h")
  pt: Bus: point_t
  heading: single

Header_t = Simulink.Bus(DataScope="Imported", HeaderFile="struct_import.h")
  len: uint32
  state: uint8
  mode: uint8
  error_code: uint16
  time_stamp: uint64

LineType = Simulink.AliasType(BaseType="int32", DataScope="Imported", HeaderFile="struct_import.h")

Line_t = Simulink.Bus(DataScope="Imported", HeaderFile="struct_import.h")
  LineType: LineType
  A: single
  B: single
  C: single

MebData_t = Simulink.Bus(DataScope="Imported", HeaderFile="struct_import.h")
  header: Bus: Header_t
  safeVel: single
  safeDistance: single
  stopPose: Bus: pose_t
  objPos: Bus: point_t

ObjectInfo_t = Simulink.Bus(DataScope="Imported", HeaderFile="struct_import.h")
  header: Bus: Header_t
  x_y_type: uint32[450]
  objNum: uint16

ObstacleInfo_t = Simulink.Bus(DataScope="Imported", HeaderFile="struct_import.h")
  boundaryData: Bus: ObjectInfo_t
  LeftObjNum: int32
  RightObjNum: int32
  FrontObjNum: int32
  RearObjNum: int32
  LeftObjs: Bus: point_t[20]
  RightObjs: Bus: point_t[20]
  FrontObjs: Bus: point_t[20]
  RearObjs: Bus: point_t[20]
  objLeft: Bus: point_t
  objRight: Bus: point_t

OdometryData_t = Simulink.Bus(DataScope="Imported", HeaderFile="struct_import.h")
  sCurPose: Bus: pose_t
  sDetPose: Bus: pose_t
  fTurnR: single
  fFwdDist: single
  mileage: single

PFData_t = Simulink.Bus(DataScope="Imported", HeaderFile="struct_import.h")
  header: Bus: Header_t
  vcData: Bus: VehicleCtrl_t
  carState: Bus: CarState_t

PathSeg_t = Simulink.Bus(DataScope="Imported", HeaderFile="struct_import.h")
  type: uint8
  CtrlType: uint8
  dir: int32
  steerAngle: single
  radius: single
  Len: single
  circleCenter: Bus: point_t
  keyPoint: Bus: pose_t

Path_t = Simulink.Bus(DataScope="Imported", HeaderFile="struct_import.h")
  header: Bus: Header_t
  segNum: uint8
  curIndex: uint8
  PathId: int32
  pathSeg: Bus: PathSeg_t[10]
  SlotEndPose: Bus: pose_t
  IsSameDir2End: uint8
  DisableSwitchRecal: uint8

Polygon_t = Simulink.Bus(DataScope="Imported", HeaderFile="struct_import.h")
  ptNum: int32
  basePt: Bus: pose_t
  pt: Bus: point_t[4]
  angle: single

Scene_t = Simulink.Bus(DataScope="Imported", HeaderFile="struct_import.h")
  objFrontState: uint8
  objRearState: uint8
  objLeftState: uint8
  objRightState: uint8
  ObjFront: Bus: point_t
  ObjRear: Bus: point_t
  ObjLeft: Bus: point_t
  ObjRight: Bus: point_t

Slot = Simulink.Bus(DataScope="Imported", HeaderFile="struct_import.h")
  slotbase: Bus: pose_t
  xLen: single
  yLen: single

Slot_t = Simulink.Bus(DataScope="Imported", HeaderFile="struct_import.h")
  header: Bus: Header_t
  slotType: uint8
  sceneType7IsRightSlot1: uint8
  sceneInfo: Bus: Scene_t
  SlotEndPose: Bus: pose_t
  SlotBasePose: Bus: pose_t
  EndOffY: single
  EndPosLine: Bus: Line_t
  parkoutPath: Bus: Path_t

UssObjs_t = Simulink.Bus(DataScope="Imported", HeaderFile="struct_import.h")
  obj: uint32[40]

UssSlot_t = Simulink.Bus(DataScope="Imported", HeaderFile="struct_import.h")
  slot: Bus: Slot[4]

VehicleCtrl_t = Simulink.Bus(DataScope="Imported", HeaderFile="struct_import.h")
  IsEnable: int32
  VCState: int32
  Speed: single
  SteerAngle: single
  Distance: single
  Acc: single
  IsAEB: int32
  Shift: int32

VehicleData_t = Simulink.Bus(DataScope="Imported", HeaderFile="struct_import.h")
  header: Bus: Header_t
  odoData: Bus: OdometryData_t
  ussObjs: Bus: UssObjs_t
  ussSlot: Bus: UssSlot_t
  vehicleSrcData: Bus: VehicleSourceData_t

VehicleSourceData_t = Simulink.Bus(DataScope="Imported", HeaderFile="struct_import.h")
  ShiftState: int32
  Dir: int32
  SteerWheelAngle: single
  radius: single
  Speed: single
  PulseSpd: single
  FLWhlDistPlsCntr: uint16
  FRWhlDistPlsCntr: uint16
  RLWhlDistPlsCntr: uint16
  RRWhlDistPlsCntr: uint16
  IsBrakePedalPress: uint8
  eps_status: uint8
  door_status: uint8
  safebelt_status: uint8
  rearmirror_status: uint8

CarState_t = Simulink.Bus(DataScope="Imported", HeaderFile="struct_import.h")
  PathId: int32
  CarFollowErr: single
  CurPathIndex: int32
  curPose: Bus: pose_t
  transform: Bus: pose_t
  PulseSpd: single
  SteerWheelAngle: single
  radius: single
  ShiftState: int32
  Dir: int32
  PreShiftState: int32

POLYGON_MAXITER = Simulink.Parameter(4, StorageClass="ExportedGlobal", DataType="int32")
pt_array = Simulink.Signal(StorageClass="ExportedGlobal", DataType="Bus: point_t", Dimensions=4)
ptinport = Simulink.Signal(StorageClass="ExportedGlobal", DataType="Bus: point_t")
KPP_safeDisSideWidth_mm = Simulink.Parameter(20, StorageClass="ExportedGlobal", DataType="single")
KPP_goodDisFrontLen_mm = Simulink.Parameter(50, StorageClass="ExportedGlobal", DataType="single")
KPP_safeDisRearLen_mm = Simulink.Parameter(50, StorageClass="ExportedGlobal", DataType="single")
output_flg = Simulink.Signal(StorageClass="ExportedGlobal", DataType="boolean")
N_TX_EVERY_STEP = Simulink.Parameter(5, StorageClass="ExportedGlobal", DataType="int32")
x_addat_pt2 = Simulink.Signal(StorageClass="ExportedGlobal", DataType="single", InitialValue="0")
x_addat_pt2_i16 = Simulink.Signal(StorageClass="ExportedGlobal", DataType="int16", InitialValue="0")
pt_x_ovrdflg = Simulink.Parameter(0, StorageClass="ExportedGlobal", DataType="boolean")
polygoni_x_ovrdflg = Simulink.Parameter(0, StorageClass="ExportedGlobal", DataType="boolean")
polygonj_x_ovrdflg = Simulink.Parameter(0, StorageClass="ExportedGlobal", DataType="boolean")
pt_x_ovrdval = Simulink.Parameter(0.1, StorageClass="ExportedGlobal", DataType="single")
polygoni_x_ovrdval = Simulink.Parameter(0.21, StorageClass="ExportedGlobal", DataType="single")
polygonj_x_ovrdval = Simulink.Parameter(0.32, StorageClass="ExportedGlobal", DataType="single")

SL_Bus_test_sendrcv_ros_time_Time = Simulink.Bus()  % MsgType=ros_time/Time
  Sec: double
  Nsec: double

SL_Bus_test_sendrcv_coros_msgs_resppacket = Simulink.Bus()  % MsgType=coros_msgs/resppacket
  Respcode: uint32
  Timestamp: Bus: SL_Bus_test_sendrcv_ros_time_Time  % MsgType=ros_time/Time
  Respstr: uint8[128]  % PrimitiveROSType=string:IsVarLen=1:VarLenCategory=data:VarLenElem=Respstr_SL_Info:TruncateAction=warn
  Respstr_SL_Info: Bus: SL_Bus_ROSVariableLengthArrayInfo  % IsVarLen=1:VarLenCategory=length:VarLenElem=Respstr
  Respoption: uint32[8]
  Data: uint8[128]  % IsVarLen=1:VarLenCategory=data:VarLenElem=Data_SL_Info:TruncateAction=warn
  Data_SL_Info: Bus: SL_Bus_ROSVariableLengthArrayInfo  % IsVarLen=1:VarLenCategory=length:VarLenElem=Data

SL_Bus_ROSVariableLengthArrayInfo = Simulink.Bus()
  CurrentLength: uint32
  ReceivedLength: uint32

SL_Bus_test_sendrcv_coros_msgs_cmdpacket = Simulink.Bus()  % MsgType=coros_msgs/cmdpacket
  Cmdcode: uint32
  Cmdstr: uint8[128]  % PrimitiveROSType=string:IsVarLen=1:VarLenCategory=data:VarLenElem=Cmdstr_SL_Info:TruncateAction=warn
  Cmdstr_SL_Info: Bus: SL_Bus_ROSVariableLengthArrayInfo  % IsVarLen=1:VarLenCategory=length:VarLenElem=Cmdstr
  Cmdoption: uint32[8]
  Data: uint8[128]  % IsVarLen=1:VarLenCategory=data:VarLenElem=Data_SL_Info:TruncateAction=warn
  Data_SL_Info: Bus: SL_Bus_ROSVariableLengthArrayInfo  % IsVarLen=1:VarLenCategory=length:VarLenElem=Data

xinport = Simulink.Signal(StorageClass="ExportedGlobal", DataType="single", InitialValue="0")
yinport = Simulink.Signal(StorageClass="ExportedGlobal", DataType="single", InitialValue="0")
y_array = Simulink.Signal(StorageClass="ExportedGlobal", DataType="single", Dimensions=3)
x_array = Simulink.Signal(StorageClass="ExportedGlobal", DataType="single", Dimensions=3)